# Grasshopper definition Floating Cities.gh (Grasshopper 1.0.7)

pt = Point([Point(-2.044453835, -1.01994122, 2.822623207), Point(-3.425046582, 8.898909087, 0), Point(3.938847176, 5.358109995, 0), Point(0.2067973791, 2.792858976, 4.800090077)])

increase_attraction = Slider(4, range=0..10)
window_coef = Slider(0.7, range=0..1)
stairdensity = Slider(0.7, range=0..1)
windowcoefficient = GetNumber(window_coef, AtLeast=1, AtMost=1, Maximum=1.797693135e+308, Minimum=-1.797693135e+308)
windowwidthratio = GetInteger(Slider(6, range=0..10), AtLeast=1, AtMost=1, Maximum=2147483647, Minimum=-2147483648)
windowheightratio = GetInteger(Slider(7, range=0..10), AtLeast=1, AtMost=1, Maximum=2147483647, Minimum=-2147483648)
increaseattraction = GetInteger(increase_attraction, AtLeast=1, AtMost=1, Maximum=2147483647, Minimum=-2147483648)
stairdensity_2 = GetNumber(stairdensity, AtLeast=1, AtMost=1, Maximum=1.797693135e+308, Minimum=-1.797693135e+308)

points = GetPoint(pt, AtLeast=1, AtMost=1, Realtime=True)
addtrees = GetInteger(Slider(7, range=0..10), AtLeast=1, AtMost=1, Maximum=2147483647, Minimum=-2147483648)

# ---- group: buildings
pgroups = PointGroups(Points=points, Distance=Slider(4, range=0..10))  # -> Groups, Indices
lng = ListLength(List=pgroups.Groups)  # -> simplify(Length)
avr = Average(Input=pgroups.Groups)
equals = Equality(FirstNumber=lng, SecondNumber="1")  # -> Equality, Inequality
dispatch = Dispatch(List=avr, DispatchPattern=equals.Equality)  # -> ListA, ListB
lng_2 = ListLength(List=pgroups.Groups)
number_slider = Slider(1, range=0..1)
multiplication = Multiplication(A=Slider(1, range=0..1), B=lng_2)
box = CenterBox(Base=dispatch.ListA, X=number_slider, Y=number_slider, Z=Slider(2, range=0..10))
box_2 = CenterBox(Base=dispatch.ListB, X=multiplication, Y=multiplication, Z=Slider(2, range=0..10))
merge = Merge(Data1=box, Data2=box_2)  # -> simplify(Result)

# ----
debrep = DeconstructBrep(Brep=merge)  # -> reparameterize(simplify(Faces)), Edges, Vertices

# ---- group: windows
panel = Panel("""0
1
2
3""")
item = ListItem(List=debrep.Faces, Index=panel, Wrap=True)
divide = DivideDomain²(Domain=simplify(item), UCount=windowwidthratio, VCount=windowheightratio)
subsrf = Isotrim(Surface=reparameterize(simplify(graft(item))), Domain=divide)  # -> simplify(Surface)
debrep_2 = DeconstructBrep(Brep=subsrf)  # -> flatten(Faces), Edges, Vertices
lng_3 = ListLength(List=debrep_2.Faces)
multiplication_2 = Multiplication(A=lng_3, B=windowcoefficient)
reduce = RandomReduce(List=debrep_2.Faces, Reduction=multiplication_2, Seed=1)
area = Area(Geometry=reduce)  # -> Area, Centroid
scale = Scale(Geometry=reduce, Center=area.Centroid, Factor=Slider(0.8, range=0..1))  # -> Geometry, Transform
vec = Vector(scale.Geometry)
amp = Amplitude(Vector=vec, Amplitude=Slider(0.1, range=0..0.1))
extr = Extrude(Base=scale.Geometry, Direction=amp)

# ---- group: ground
item_2 = ListItem(List=debrep.Faces, Index="4", Wrap=True)
area_2 = Area(Geometry=item_2)  # -> Area, Centroid
pgroups_2 = PointGroups(Points=flatten(area_2.Centroid), Distance=increaseattraction)  # -> Groups, Indices
lng_4 = ListLength(List=pgroups_2.Groups)  # -> simplify(Length)
avr_2 = Average(Input=pgroups_2.Groups)
equals_2 = Equality(FirstNumber=lng_4, SecondNumber="1")  # -> Equality, Inequality
dispatch_2 = Dispatch(List=avr_2, DispatchPattern=equals_2.Equality)  # -> ListA, ListB
lng_5 = ListLength(List=pgroups_2.Groups)
number_slider_2 = Slider(0.1, range=0..1)
number_slider_3 = Slider(2.5, range=0..10)
multiplication_3 = Multiplication(A=number_slider_3, B=lng_5)
multiplication_4 = Multiplication(A=number_slider_2, B=lng_5)
box_3 = CenterBox(Base=area_2.Centroid, X=number_slider_3, Y=number_slider_3, Z=number_slider_2)
box_4 = CenterBox(Base=dispatch_2.ListB, X=multiplication_3, Y=multiplication_3, Z=multiplication_4)
merge_2 = Merge(Data1=box_3, Data2=box_4)

# ----
mesh = MeshBrep(
    Brep=extr,
    Settings={GridMaxCount=0, GridMinCount=16, JaggedSeams=False, MaxEdgeLength=0, MinEdgeLength=0.0001, MinTolerance=0, Refine=True, RefineAngle=0, RelativeTolerance=0.65, SimplePlanes=True, Tolerance=0})

# ---- group: Stairs
brep = Brep(flatten(merge_2))
debrep_3 = DeconstructBrep(Brep=brep)  # -> Faces, Edges, Vertices
item_3 = ListItem(List=debrep_3.Faces, Index="5", Wrap=True)
debrep_4 = DeconstructBrep(Brep=item_3)  # -> Faces, simplify(Edges), Vertices
tstat = TreeStatistics(Tree=debrep_4.Edges)  # -> Paths, Length, Count
series = Series(Start=12, Step=1, Count=tstat.Count)
series_2 = Series(Start=0, Step=1, Count=tstat.Count)
jitter = Jitter(List=debrep_4.Edges, Jitter=1, Seed=graft(series))  # -> Values, Indices
jitter_2 = Jitter(List=debrep_4.Edges, Jitter=1, Seed=graft(series_2))  # -> Values, Indices
item_4 = ListItem(List=jitter.Values, Index=0, Wrap=True)
item_5 = ListItem(List=jitter_2.Values, Index=0, Wrap=True)
curvepoint = PointOnCurve(item_4, parameter=0.333)
curvepoint_2 = PointOnCurve(item_5, parameter=0.333)
pgroups_3 = PointGroups(Points=flatten(curvepoint), Distance=Slider(5, range=0..10))  # -> Groups, Indices
pgroups_4 = PointGroups(Points=flatten(curvepoint_2), Distance=Slider(5, range=0..10))  # -> Groups, Indices
pline = PolyLine(Vertices=pgroups_3.Groups, Closed=False)  # -> flatten(Polyline)
pline_2 = PolyLine(Vertices=pgroups_4.Groups, Closed=False)  # -> flatten(Polyline)
null = NullItem(Item=pline)  # -> NullFlags, InvalidFlags, Description
null_2 = NullItem(Item=pline_2)  # -> NullFlags, InvalidFlags, Description
cull = CullPattern(List=pline, CullPattern=invert(null.NullFlags))
cull_2 = CullPattern(List=pline_2, CullPattern=invert(null_2.NullFlags))
divlength = DivideLength(Curve=[cull_2, cull], Length=stairdensity_2)  # -> simplify(Points), Tangents, Parameters
number_slider_4 = Slider(0.4, range=0..1)
box_5 = CenterBox(Base=divlength.Points, X=number_slider_4, Y=number_slider_4, Z=Slider(0.1, range=0..0.1))

# ---- group: Trees
sdiff = SolidDifference(BrepsA=item_3, BrepsB=item_2)
srf = Surface(flatten(sdiff))
popgeo = PopulateGeometry(Geometry=srf, Count=addtrees, Seed=1)
pt_2 = Point(Point(-1.865918762, -9.221637891, 1.098359503))
mesh_2 = Mesh(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)
xy = XYPlane(Origin=popgeo)  # -> flatten(Plane)
xy_2 = XYPlane(Origin=pt_2)
lng_6 = ListLength(List=xy)
series_3 = Series(Start=0, Step=0.2, Count=lng_6)
prot = RotatePlane(Plane=graft(xy), Angle=graft(series_3))
orient = Orient(Geometry=mesh_2, Source=xy_2, Target=prot)  # -> Geometry, Transform

# ----
preview = CustomPreview(Geometry=merge, Material=ColourSwatch(SwatchColor=RGB(219, 199, 181)))

# ---- group: RH_OUT:Buildings
mesh_3 = Mesh(merge)

# ---- group: RH_OUT:Stairs
mesh_4 = Mesh(box_5)

# ---- group: RH_OUT:Glazing
mesh_5 = Mesh(mesh)

# ---- group: RH_OUT:Ground
mesh_6 = Mesh(merge_2)

# ---- group: RH_OUT:Trees
mesh_7 = Mesh(orient.Geometry)

# ----
preview_2 = CustomPreview(Geometry=[merge_2, box_5, orient.Geometry], Material=ColourSwatch(SwatchColor=RGB(100, 164, 58)))
preview_3 = CustomPreview(Geometry=extr, Material=ColourSwatch(SwatchColor=RGB(23, 187, 181)))
