# Grasshopper definition Flowing Cities.gh (Grasshopper 1.0.7)

pt = Point([<point referenced from the Rhino model> x4])

increase_attraction = Slider(4, range=0..10)
window_coef = Slider(0.7, range=0..1)
stairdensity = Slider(0.7, range=0..1)
windowcoefficient = GetNumber(window_coef, AtLeast=1, AtMost=1, Maximum=1.797693135e+308, Minimum=-1.797693135e+308)
windowwidthratio = GetInteger(Slider(6, range=0..10), AtLeast=1, AtMost=1, Maximum=2147483647, Minimum=-2147483648)
windowheightratio = GetInteger(Slider(7, range=0..10), AtLeast=1, AtMost=1, Maximum=2147483647, Minimum=-2147483648)
increaseattraction = GetInteger(increase_attraction, AtLeast=1, AtMost=1, Maximum=2147483647, Minimum=-2147483648)
stairdensity_2 = GetNumber(stairdensity, AtLeast=1, AtMost=1, Maximum=1.797693135e+308, Minimum=-1.797693135e+308)

points = GetPoint(pt, AtLeast=1, AtMost=1, Realtime=True)
addtrees = GetInteger(Slider(7, range=0..10), AtLeast=1, AtMost=1, Maximum=2147483647, Minimum=-2147483648)

# ---- group: buildings
pgroups = PointGroups(Points=points, Distance=Slider(4, range=0..10))  # -> Groups, Indices
lng = ListLength(List=pgroups.Groups)  # -> simplify(Length)
avr = Average(Input=pgroups.Groups)
equals = Equality(FirstNumber=lng, SecondNumber="1")  # -> Equality, Inequality
dispatch = Dispatch(List=avr, DispatchPattern=equals.Equality)  # -> ListA, ListB
lng_2 = ListLength(List=pgroups.Groups)
number_slider = Slider(1, range=0..1)
multiplication = Multiplication(A=Slider(1, range=0..1), B=lng_2)
box = CenterBox(Base=dispatch.ListA, X=number_slider, Y=number_slider, Z=Slider(2, range=0..10))
box_2 = CenterBox(Base=dispatch.ListB, X=multiplication, Y=multiplication, Z=Slider(2, range=0..10))
merge = Merge(Data1=box, Data2=box_2)  # -> simplify(Result)

# ----
debrep = DeconstructBrep(Brep=merge)  # -> reparameterize(simplify(Faces)), Edges, Vertices; disabled

# ---- group: windows
panel = Panel("""0
1
2
3""")  # disabled
item = ListItem(List=debrep.Faces, Index=panel, Wrap=True)  # disabled
divide = DivideDomain²(Domain=simplify(item), UCount=windowwidthratio, VCount=windowheightratio)  # disabled
subsrf = Isotrim(Surface=reparameterize(simplify(graft(item))), Domain=divide)  # -> simplify(Surface); disabled
debrep_2 = DeconstructBrep(Brep=subsrf)  # -> flatten(Faces), Edges, Vertices; disabled
lng_3 = ListLength(List=debrep_2.Faces)  # disabled
multiplication_2 = Multiplication(A=lng_3, B=windowcoefficient)  # disabled
reduce = RandomReduce(List=debrep_2.Faces, Reduction=multiplication_2, Seed=1)  # disabled
number_slider_2 = Slider(0.8, range=0..1)  # disabled
area = Area(Geometry=reduce)  # -> Area, Centroid; disabled
scale = Scale(Geometry=reduce, Center=area.Centroid, Factor=number_slider_2)  # -> Geometry, Transform; disabled
number_slider_3 = Slider(0.01, range=0..0.01)  # disabled
vec = Vector(scale.Geometry)  # disabled
amp = Amplitude(Vector=vec, Amplitude=number_slider_3)  # disabled
move = Move(Geometry=scale.Geometry, Motion=amp)  # -> Geometry, Transform; disabled

# ---- group: ground
panel_2 = Panel("4")  # disabled
item_2 = ListItem(List=debrep.Faces, Index=panel_2, Wrap=True)  # disabled
area_2 = Area(Geometry=item_2)  # -> Area, Centroid; disabled
pgroups_2 = PointGroups(Points=flatten(area_2.Centroid), Distance=increaseattraction)  # -> Groups, Indices; disabled
lng_4 = ListLength(List=pgroups_2.Groups)  # -> simplify(Length); disabled
panel_3 = Panel("1")  # disabled
avr_2 = Average(Input=pgroups_2.Groups)  # disabled
equals_2 = Equality(FirstNumber=lng_4, SecondNumber=panel_3)  # -> Equality, Inequality; disabled
dispatch_2 = Dispatch(List=avr_2, DispatchPattern=equals_2.Equality)  # -> ListA, ListB; disabled
lng_5 = ListLength(List=pgroups_2.Groups)  # disabled
number_slider_4 = Slider(0.1, range=0..1)  # disabled
number_slider_5 = Slider(2.5, range=0..10)  # disabled
multiplication_3 = Multiplication(A=number_slider_5, B=lng_5)  # disabled
multiplication_4 = Multiplication(A=number_slider_4, B=lng_5)  # disabled
box_3 = CenterBox(Base=area_2.Centroid, X=number_slider_5, Y=number_slider_5, Z=number_slider_4)  # disabled
box_4 = CenterBox(Base=dispatch_2.ListB, X=multiplication_3, Y=multiplication_3, Z=multiplication_4)  # disabled
merge_2 = Merge(Data1=box_3, Data2=box_4)  # disabled

# ---- group: Stairs
brep = Brep(flatten(merge_2))  # disabled
debrep_3 = DeconstructBrep(Brep=brep)  # -> Faces, Edges, Vertices; disabled
panel_4 = Panel("5")  # disabled
item_3 = ListItem(List=debrep_3.Faces, Index=panel_4, Wrap=True)  # disabled
debrep_4 = DeconstructBrep(Brep=item_3)  # -> Faces, simplify(Edges), Vertices; disabled
tstat = TreeStatistics(Tree=debrep_4.Edges)  # -> Paths, Length, Count; disabled
series = Series(Start=12, Step=1, Count=tstat.Count)  # disabled
series_2 = Series(Start=0, Step=1, Count=tstat.Count)  # disabled
jitter = Jitter(List=debrep_4.Edges, Jitter=1, Seed=graft(series))  # -> Values, Indices; disabled
jitter_2 = Jitter(List=debrep_4.Edges, Jitter=1, Seed=graft(series_2))  # -> Values, Indices; disabled
item_4 = ListItem(List=jitter.Values, Index=0, Wrap=True)  # disabled
item_5 = ListItem(List=jitter_2.Values, Index=0, Wrap=True)  # disabled
number_slider_6 = Slider(5, range=0..10)  # disabled
number_slider_7 = Slider(5, range=0..10)  # disabled
curvepoint = PointOnCurve(item_4, parameter=0.333)  # disabled
curvepoint_2 = PointOnCurve(item_5, parameter=0.333)  # disabled
pgroups_3 = PointGroups(Points=flatten(curvepoint), Distance=number_slider_7)  # -> Groups, Indices; disabled
pgroups_4 = PointGroups(Points=flatten(curvepoint_2), Distance=number_slider_6)  # -> Groups, Indices; disabled
pline = PolyLine(Vertices=pgroups_3.Groups, Closed=False)  # -> flatten(Polyline); disabled
pline_2 = PolyLine(Vertices=pgroups_4.Groups, Closed=False)  # -> flatten(Polyline); disabled
null = NullItem(Item=pline)  # -> NullFlags, InvalidFlags, Description; disabled
null_2 = NullItem(Item=pline_2)  # -> NullFlags, InvalidFlags, Description; disabled
cull = CullPattern(List=pline, CullPattern=invert(null.NullFlags))  # disabled
cull_2 = CullPattern(List=pline_2, CullPattern=invert(null_2.NullFlags))  # disabled
divlength = DivideLength(Curve=[cull_2, cull], Length=stairdensity_2)  # -> simplify(Points), Tangents, Parameters; disabled
number_slider_8 = Slider(0.4, range=0..1)  # disabled
number_slider_9 = Slider(0.1, range=0..0.1)  # disabled
box_5 = CenterBox(Base=divlength.Points, X=number_slider_8, Y=number_slider_8, Z=number_slider_9)  # disabled

# ---- group: Trees
sdiff = SolidDifference(BrepsA=item_3, BrepsB=item_2)  # disabled
srf = Surface(flatten(sdiff))  # disabled
popgeo = PopulateGeometry(Geometry=srf, Count=addtrees, Seed=1)  # disabled
pt_2 = Point(Point(-1.865918762, -9.221637891, 1.098359503))  # disabled
mesh = Mesh(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)  # disabled
xy = XYPlane(Origin=popgeo)  # -> flatten(Plane); disabled
xy_2 = XYPlane(Origin=pt_2)  # disabled
lng_6 = ListLength(List=xy)  # disabled
series_3 = Series(Start=0, Step=0.2, Count=lng_6)  # disabled
prot = RotatePlane(Plane=graft(xy), Angle=graft(series_3))  # disabled
orient = Orient(Geometry=mesh, Source=xy_2, Target=prot)  # -> Geometry, Transform; disabled

# ----
swatch = ColourSwatch(SwatchColor=RGB(219, 199, 181))  # disabled

# ---- group: RH_OUT:Buildings
mesh_2 = Mesh(merge)

# ----
preview = CustomPreview(Geometry=merge, Material=swatch)  # disabled

# ---- group: RH_OUT:Stairs
mesh_3 = Mesh(box_5)  # disabled

# ---- group: RH_OUT:Windows
mesh_4 = Mesh(move.Geometry)  # disabled

# ----
swatch_2 = ColourSwatch(SwatchColor=RGB(100, 164, 58))  # disabled

# ---- group: RH_OUT:Ground
mesh_5 = Mesh(merge_2)  # disabled

# ---- group: RH_OUT:Trees
mesh_6 = Mesh(orient.Geometry)  # disabled

# ----
preview_2 = CustomPreview(Geometry=[merge_2, box_5, orient.Geometry], Material=swatch_2)  # disabled
swatch_3 = ColourSwatch(SwatchColor=RGB(23, 187, 181))  # disabled
preview_3 = CustomPreview(Geometry=move.Geometry, Material=swatch_3)  # disabled
