# Grasshopper definition kaleidoscope.gh (Grasshopper 1.0.7)

angle_of_rotation = Slider(0.44, range=0..3.14)
change_seed = GetInteger(Slider(6, range=0..10), AtLeast=1, AtMost=1, Maximum=2147483647, Minimum=-2147483648)
change_rotation_angle = GetNumber(angle_of_rotation, AtLeast=1, AtMost=1, Maximum=1.797693135e+308, Minimum=-1.797693135e+308)
hex_radius = Slider(10, range=0..10)
number_slider = Slider(50, range=0..100)
number_slider_2 = Slider(20, range=0..100)
rad = Radians(Degrees="30")
vrot = Rotate(Vector="1,0,0", Axis="0,0,1", Angle=rad)
cos = Cosine(Value=rad)
expression = Expression(x=number_slider_2, y=cos, Expression="x*y*2")
amp = Amplitude(Vector=vrot, Amplitude=expression)
number_slider_3 = Slider(4, range=0..10)
arrlinear = LinearArray(Geometry="-40,-20,0", Direction=amp, Count="4")  # -> Geometry, Transform
vec = VectorXYZ(XComponent=0, YComponent=expr("-x", expression), ZComponent=0)  # -> Vector, Length
vec_2 = VectorXYZ(XComponent=0, YComponent=expression, ZComponent=0)  # -> Vector, Length
arrlinear_2 = LinearArray(Geometry=arrlinear.Geometry, Direction=graft([vec_2.Vector, vec.Vector]), Count=number_slider_3)  # -> simplify(Geometry), Transform
multiplication = Multiplication(A=number_slider_3, B=expression)
dom = ConstructDomain(DomainStart=expr("-x", multiplication), DomainEnd=multiplication)
dom_2 = ConstructDomain(DomainStart=expr("-x/2", multiplication), DomainEnd=expr("x/2", multiplication))
bang = ExplodeTree(Data=arrlinear_2.Geometry)  # -> Branch0, Branch1, Branch2, Branch3, Branch4, Branch5, Branch6, Branch7
cull_i = CullIndex(List=[bang.Branch0, bang.Branch1, bang.Branch2, bang.Branch3], Indices=0, Wrap=True)
merge = Merge(Data1=cull_i, Data2=bang.Branch4, Data3=bang.Branch5, Data4=bang.Branch6, Data5=bang.Branch7)  # -> flatten(Result)
rectangle = Rectangle(Plane=PlaneXY(0, 0, 0), XSize=dom, YSize=dom_2, Radius=0)  # -> Rectangle, Length
incurve = PointInCurve(Point=merge, Curve=rectangle.Rectangle)  # -> Relationship, Point
bool = Boolean(incurve.Relationship)
pt = Point(incurve.Point)
cull = CullPattern(List=merge, CullPattern=bool)
xy = XYPlane(Origin=cull)
polygon = Polygon(Plane=graft(xy), Radius=number_slider_2, Segments=6, FilletRadius=0)  # -> simplify(Polygon), Length
rotate = Rotate(Geometry=simplify(polygon.Polygon), Angle=change_rotation_angle, Plane=graft(xy))  # -> Geometry, Transform
dom_3 = ConstructDomain(DomainStart=expr("-x+4", number_slider_2), DomainEnd=expr("x-4", number_slider_2))
explode = Explode(Curve=rotate.Geometry, Recursive=True)  # -> Segments, Vertices
rectangle_2 = Rectangle(Plane=xy, XSize=dom_3, YSize=dom_3, Radius=0)  # -> Rectangle, Length
cull_2 = CullPattern(List=explode.Vertices, CullPattern=[False, False, True])
cull_3 = CullPattern(List=explode.Vertices, CullPattern=[True, False, False, True, False, False, False])
cull_4 = CullPattern(List=explode.Vertices, CullPattern=[False, True, False])
pline = PolyLine(Vertices=cull_2, Closed=False)
pline_2 = PolyLine(Vertices=cull_3, Closed=False)
pline_3 = PolyLine(Vertices=cull_4, Closed=False)
pop2d = Populate2D(Region=graft(rectangle_2.Rectangle), Count=Slider(15, range=0..100), Seed=change_seed)
number_slider_4 = Slider(0.7, range=0..1)
extr = Extrude(Base=pline, Direction="0,0,1")
extr_2 = Extrude(Base=pline_3, Direction="0,0,1")
extr_3 = Extrude(Base=pline_2, Direction="0,0,1")
msphere = MeshSphere(Base=pop2d, Radius=Slider(1.5, range=0..10), UCount=10, VCount=20)
popgeo = PopulateGeometry(Geometry=msphere, Count=Slider(12, range=0..100), Seed=1)  # -> simplify(Population)
facet = FacetDome(Points=popgeo)  # -> Pattern, simplify(Dome)
mjoin = MeshJoin(Meshes=facet.Pattern)
weld = WeldMesh(Mesh=mjoin, Angle=3.141592654)  # -> simplify(Result)
trim = TrimTree(Tree=weld, Depth=1)
area = Area(Geometry=polygon.Polygon)  # -> Area, Centroid
explode_2 = Explode(Curve=polygon.Polygon, Recursive=True)  # -> Segments, simplify(Vertices)
mirror = Mirror(Geometry=trim, Plane=simplify(graft(extr)))  # -> simplify(Geometry), Transform
explode_3 = Explode(Curve=flatten(polygon.Polygon), Recursive=True)  # -> flatten(Segments), Vertices
ln = Line(StartPoint=area.Centroid, EndPoint=explode_2.Vertices)  # -> simplify(Line)
merge_2 = Merge(Data1=trim, Data2=mirror.Geometry)
merge_3 = Merge(Data1=ln, Data2=explode_3.Segments)  # -> flatten(Result)
lng = ListLength(List=merge_3)
mirror_2 = Mirror(Geometry=merge_2, Plane=simplify(graft(extr_3)))  # -> simplify(Geometry), Transform
range = Range(Domain=Domain(0, 1), Steps=lng)
line = Line(merge_3)
merge_4 = Merge(Data1=trim, Data2=mirror.Geometry, Data3=mirror_2.Geometry)
gradient = Gradient(
    LowerLimit=0,
    UpperLimit=1,
    Parameter=range,
    stops=[0.0342: RGB(99, 116, 160), 0.32: RGB(239, 18, 193), 0.668: RGB(133, 132, 40), 1: RGB(47, 27, 223), 1: RGB(148, 157, 134)])
mirror_3 = Mirror(Geometry=merge_4, Plane=graft(extr_2))  # -> simplify(Geometry), Transform
merge_5 = Merge(Data1=merge_4, Data2=mirror_3.Geometry)
c_script = CSharpScript(crv=line, color=gradient)  # -> out, A; inputs crv: Curve, color: Color; disabled
# ---------- c_script: C# ----------
    var c = color.R + "," + color.G + "," + color.B;
    crv.SetUserString("color", c);
    A = crv;
# ---------- end c_script ----------
crv = Curve(c_script.A)  # disabled

# ---- group: RH_OUT:curves
crv_2 = Curve(line)

# ----
tstat = TreeStatistics(Tree=merge_5)  # -> Paths, Length, Count
item = ListItem(List=tstat.Length, Index=0, Wrap=True)
lng_2 = ListLength(List=tstat.Paths)
range_2 = Range(Domain=Domain(0, 1), Steps=item)
gradient_2 = Gradient(
    LowerLimit=0,
    UpperLimit=1,
    Parameter=range_2,
    stops=[0.0342: RGB(49, 50, 160), 0.307: RGB(255, 255, 193), 0.604: RGB(184, 255, 162), 1: RGB(175, 40, 255), 1: RGB(47, 27, 223), 1: RGB(148, 157, 134)])
preview = CustomPreview(Geometry=merge_5, Material=gradient_2)
c_script_2 = CSharpScript(mesh=merge_5, color=gradient_2)  # -> out, A; inputs mesh: Mesh, color: Color; disabled
# ---------- c_script_2: C# ----------
    var c = color.R + "," + color.G + "," + color.B;
    mesh.SetUserString("color", c);
    A = mesh;
# ---------- end c_script_2 ----------

# ---- group: RH_OUT:meshes
mesh = Mesh(merge_5)

# ----
mesh_2 = Mesh(c_script_2.A)  # disabled
